# Grasshopper definition framebuffer.gh (Grasshopper 1.0.4)
# plug-ins: ghgl

pt = Point(Point(-3, 3, 0))
path = FilePath("C:\dev\github\mcneel\ghgl\tests\quito_graffiti.jpg")
gl_shader = GLShader(
    world_vertex=pt,
    radius=Slider(32, range=1..1050),
    amount=Slider(1.49, range=0..50),
    DrawMode=0,
    FragmentShader="""#version 330 core

uniform vec2 _viewportSize;
uniform sampler2D _frameBufferColor;
uniform float amount;
in vec2 texture_coordinate;

out vec4 fragment_color;
void main() 
{
  if(amount > 0.01) {
    float x = texture_coordinate.s * _viewportSize.x;
    x = x - mod(x,amount) + amount * 0.5;
    x = x / _viewportSize.x;
    float y = texture_coordinate.t * _viewportSize.y;
    y = y - mod(y,amount) + amount * 0.5;
    y = y / _viewportSize.y;
    vec2 p = vec2(x,y);
    fragment_color = texture(_frameBufferColor, p);
  } else {
    fragment_color = texture(_frameBufferColor, texture_coordinate);
  }
}""",
    GeometryShader="""#version 330 core

layout(points) in;
layout(triangle_strip, max_vertices = 4) out;

uniform float radius;
uniform mat4 _worldToClip;

out vec2 texture_coordinate;

void main()
{
  vec4 center =  gl_in[0].gl_Position;

  texture_coordinate = vec2(0.0,1.0);
  gl_Position = _worldToClip * vec4(center.x-radius, center.y-radius, center.z, 1);
  EmitVertex();

  texture_coordinate = vec2(1.0,1.0);
  gl_Position = _worldToClip * vec4(center.x+radius, center.y-radius, center.z, 1);
  EmitVertex();

  texture_coordinate = vec2(0.0,0.0);
  gl_Position = _worldToClip * vec4(center.x-radius, center.y+radius, center.z, 1);
  EmitVertex();

  texture_coordinate = vec2(1.0,0.0);
  gl_Position = _worldToClip * vec4(center.x+radius, center.y+radius, center.z, 1);
  EmitVertex();

  EndPrimitive();
}""",
    glLineWidth=3,
    glPointSize=8,
    GLShader=(0, 1, 0),
    VertexShader="""#version 330

layout(location = 0) in vec3 world_vertex;

void main() {
  gl_Position = vec4(world_vertex,1);
}""")
